# Grasshopper definition Urban Restitution.gh (Grasshopper 1.0.8)

# ----
# Building Interface:
# Open Polyline
# 
# Street Interface:
# Open Polyline
density_of_grids = Slider(3, range=0..10)
size_of_grids = Slider(13, range=0..25)
street_offset = Slider(6, range=0..25)
density_of_gridb = Slider(3, range=0..10)
street_interface = Curve(<curve referenced from the Rhino model>)
# Secondary Inputs (Typology Placement)
building_interface = Curve(<curve referenced from the Rhino model>)
building_offset = Slider(5, range=0..25)
size_of_gridb = Slider(8, range=0..25)

gate = StreamGate(Stream=street_interface, Gate=Toggle(True))  # -> Target0, Target1
gate_2 = StreamGate(Stream=building_interface, Gate=Toggle(False))  # -> Target0, Target1
flip = FlipCurve(Curve=gate.Target1)  # -> Curve, Flag
flip_2 = FlipCurve(Curve=gate_2.Target1)  # -> Curve, Flag
relay = Relay([gate.Target0, flip.Curve])
series = Series(Start=street_offset, Step=size_of_grids, Count=density_of_grids)
xy = XYPlane(Origin=Point(0, 0, 0))
xy_2 = XYPlane(Origin=Point(0, 0, 0))
series_2 = Series(Start=building_offset, Step=size_of_gridb, Count=density_of_gridb)
# Grid Construction
relay_2 = Relay([gate_2.Target0, flip_2.Curve])
offset = OffsetCurve(Curve=relay_2, Distance=series_2, Plane=xy_2, Corners=1)
offset_2 = OffsetCurve(Curve=relay, Distance=series, Plane=xy, Corners=1)
flatten = FlattenTree(Tree=offset, Path="{0}")
ccx = CurveCurve(CurveA=flatten, CurveB=offset_2)  # -> Points, ParamsA, ParamsB

temperature = Slider(3, range=-5..5)
# Primary Inputs (Ranking System)
csv_file = FilePath("C:\Users\liamr\Desktop\Ga Tech Stuff\GaTech Arch\Spring 2026\Special topic\Urban Restitution.csv")
wind = Slider(2, range=-5..5)
sun = Slider(4, range=-5..5)
rain = Slider(1, range=-5..5)
pedestrian_density = Slider(2, range=-5..5)
aesthetics = Slider(1, range=-5..5)
privacy = Slider(-3, range=-5..5)

panel = Panel([temperature, wind, rain, sun, pedestrian_density, privacy, aesthetics])

file = ReadFile(File=csv_file, PerLineParse=True)
graft = GraftTree(Tree=file, IncludeEmptyLists=True, IncludeNullItems=True)
split = TextSplit(Text=graft, Separators=",")
cull_i = CullIndex(List=split, Indices="0", Wrap=True)
join = TextJoin(Text=cull_i, Join=",")
flatten_2 = FlattenTree(Tree=join, Path="{0}")
domain_start = Slider(0, range=-5..5)
domain_end = Slider(5, range=-5..5)
domain_start_2 = Slider(-5, range=-5..5)
domain_end_2 = Slider(-1, range=-5..5)
panel_2 = Panel("""True
False""")
split_2 = SplitList(List=flatten_2, Index="4")  # -> ListA, ListB
dom = ConstructDomain(DomainStart=domain_start_2, DomainEnd=domain_end_2)
dom_2 = ConstructDomain(DomainStart=domain_start, DomainEnd=domain_end)
# List/Data Tree Organization and Manipulation
dispatch = Dispatch(List=split_2.ListB, DispatchPattern=panel_2)  # -> ListA, ListB
inc = Includes(Value=panel, Domain=dom)  # -> Includes, Deviation
inc_2 = Includes(Value=panel, Domain=dom_2)  # -> Includes, Deviation
dispatch_2 = Dispatch(List=dispatch.ListA, DispatchPattern=inc_2.Includes)  # -> ListA, ListB
dispatch_3 = Dispatch(List=dispatch.ListB, DispatchPattern=inc.Includes)  # -> ListA, ListB
split_3 = SplitList(List=split_2.ListA, Index="1")  # -> ListA, ListB
weave = Weave(Pattern=inc.Includes, Stream0=dispatch_2.ListA, Stream1=dispatch_3.ListA, NullGaps=False)
split_4 = SplitList(List=split_3.ListB, Index="1")  # -> ListA, ListB
split_5 = TextSplit(Text=weave, Separators=",")
split_6 = SplitList(List=split_4.ListB, Index="1")  # -> ListA, ListB
flip_3 = FlipMatrix(Data=split_5)

abs = Absolute(Value=panel)

split_7 = TextSplit(Text=split_3.ListA, Separators=",")
split_8 = TextSplit(Text=split_4.ListA, Separators=",")
split_9 = TextSplit(Text=split_6.ListA, Separators=",")
split_10 = TextSplit(Text=split_6.ListB, Separators=",")

multiplication = Multiplication(A=flip_3, B=abs)
ma = MassAddition(Input=multiplication)  # -> Result, PartialResults
# Final Ranking and List Sorting
flip_4 = FlipMatrix(Data=ma.Result)
entwine = Entwine(Branch00=split_7, Branch01=flip_4, FlattenInputs=True)
flip_5 = FlipMatrix(Data=entwine)
join_2 = TextJoin(Text=flip_5, Join=",")
flatten_3 = FlattenTree(Tree=join_2, Path="{0}")
sort = SortList(Keys=flip_4, ValuesA=flatten_3)  # -> Keys, ValuesA
rev = ReverseList(List=sort.ValuesA)

panel_3 = Panel(rev)

sort_2 = SortList(Keys=flip_4, ValuesA=split_8)  # -> Keys, ValuesA
sort_3 = SortList(Keys=flip_4, ValuesA=split_9)  # -> Keys, ValuesA
sort_4 = SortList(Keys=flip_4, ValuesA=split_10)  # -> Keys, ValuesA
# Intervention Creation and Placement
rev_2 = ReverseList(List=sort_2.ValuesA)
rev_3 = ReverseList(List=sort_3.ValuesA)
rev_4 = ReverseList(List=sort_4.ValuesA)
split_11 = SplitList(List=rev_2, Index="1")  # -> ListA, ListB
split_12 = SplitList(List=rev_3, Index="1")  # -> ListA, ListB
split_13 = SplitList(List=rev_4, Index="1")  # -> ListA, ListB
gate_3 = StreamGate(Stream=split_12.ListA, Gate=split_11.ListA)  # -> Target0, Target1
gate_4 = StreamGate(Stream=split_13.ListA, Gate=split_11.ListA)  # -> Target0, Target1
division = Division(A=split_12.ListA, B="2")
division_2 = Division(A=split_13.ListA, B="2")
multiplication_2 = Multiplication(A=division_2, B="-1")
multiplication_3 = Multiplication(A=division, B="-1")
vec = VectorXYZ(XComponent=multiplication_3, YComponent=multiplication_2, ZComponent=0)  # -> Vector, Length
rectangle = Rectangle(Plane=ccx.Points, XSize=gate_3.Target0, YSize=gate_4.Target0, Radius=0)  # -> Rectangle, Length
ellipse = Ellipse(Plane=ccx.Points, Radius1=gate_3.Target1, Radius2=gate_4.Target1)  # -> Ellipse, Focus1, Focus2
move = Move(Geometry=rectangle.Rectangle, Motion=vec.Vector)  # -> Geometry, Transform
